# Grasshopper definition mycobot_artist_grasshopper.ghx (Grasshopper 1.0.7)
# plug-ins: GH_CPython

reload = Button()
py = PythonScript(reload=reload)
# ---------- py: Python ----------
if reload:
    from compas_ghpython import unload_modules
    unload_modules('compas')
# ---------- end py ----------

# ----
# Robot
load = Button()

python = PythonScript(load=load)  # -> robot
# ---------- python: Python ----------
from scriptcontext import sticky as st

import compas
from compas.robots import LocalPackageMeshLoader
from compas.robots import RobotModel

import compas_fab
from compas_fab.robots import Robot
from compas_ghpython.artists import RobotModelArtist
import os
# Set high precision to import meshes defined in meters
compas.PRECISION = '12f'

# Store robot in component-based key
robot_key = 'robot_{}'.format(str(ghenv.Component.InstanceGuid))
if robot_key not in st:
    st[robot_key] = None

if load:
    # Locate the URDF file inside compas fab installation
    #urdf = compas_fab.get(os.path.dirname(ghdoc.Path)+'\mycobot\mycobot_description\urdf\mycobot.urdf') #' ' is mycobot.urdf's directory
    urdf = os.path.dirname(ghdoc.Path)+'\mycobot\mycobot_description\urdf\mycobot.urdf' #' ' is mycobot.urdf's directory
    # Create robot model from URDF
    model = RobotModel.from_urdf_file(urdf)

    # Also load geometry
    loader = LocalPackageMeshLoader(os.path.dirname(ghdoc.Path)+'\mycobot', 'mycobot_description')
    model.load_geometry(loader)
    artist = RobotModelArtist(model)
    robot = Robot(model, artist)
    st[robot_key] = robot
robot = st[robot_key]
print(type(robot))
# ---------- end python ----------

robot = Data(python)

# ---- group: forward kinematics
# Configuration
a1 = Slider(-28, range=-180..180)
a2 = Slider(-5, range=-90..90)
a3 = Slider(-42, range=-180..180)
a4 = Slider(56, range=-180..180)
a5 = Slider(-84, range=-180..180)
a6 = Slider(-123, range=-180..180)
forward_kinematics = PythonScript(robot=robot, a1=a1, a2=a2, a3=a3, a4=a4, a5=a5, a6=a6)  # -> configuration
# ---------- forward_kinematics: Python ----------
import math
from compas_fab.robots import Configuration

if robot:
    configuration = [a1, a2, a3, a4, a5, a6]
    configuration = Configuration.from_revolute_values([math.radians(a) for a in configuration])
# ---------- end forward_kinematics ----------

# ---- group: robotarm_control
# control
neg = Negative(Value=a1)
neg_2 = Negative(Value=a2)
neg_3 = Negative(Value=a5)
neg_4 = Negative(Value=a4)
neg_5 = Negative(Value=a6)
mycobot = Mycobot(a1=neg, a2=neg_2, a3=a3, a4=neg_4, a5=neg_3, a6=neg_5)  # -> output; inputs a1: list, a2: list, a3: list, a4: list, a5: list, a6: list; disabled
# ---------- mycobot: Python ----------
# -*- coding: utf-8 -*-
""" 
Python Script
Created on  Monday May 2021 07:08:26 
@author:  User 

[desc]
Description of the plugin Here
Write here any thing... 
[/desc]

ARGUMENTS:
----------
<inp> 
    _input :[required] - [type = int] - [default = None] 
    Descripe your input here 
        * bullet point.
        * bullet point
</inp>
<inp>
    Other inputs go here ...
</inp>

RETURN:
----------
    <out>
        output_ : indicate your output description here. \n refers to a new line.
    </out>

"""
from pymycobot.mycobot import MyCobot
mycobot = MyCobot('com4') #'com4' is com port number in my case. You need to adapt its number in your case.
mycobot.send_angles([a1,a2,a3,a4,a5,a6], 80)
# ---------- end mycobot ----------

# ----
# Visualisation
show_end_effector_frame = BooleanToggle(False)
show_base_frame = BooleanToggle(False)
show_collision = BooleanToggle(False)
show_frames = BooleanToggle(False)
show_visual = BooleanToggle(True)
visualize = PythonScript(
    robot=robot,
    configuration=forward_kinematics,
    show_visual=show_visual,
    show_collision=show_collision,
    show_frames=show_frames,
    show_base_frame=show_base_frame,
    show_end_effector_frame=show_end_effector_frame)  # -> visual, collision, frames, ee_frame, base_frame
# ---------- visualize: Python ----------
"""Visualizes a robot.
    Inputs:
        robot: The robot
        configuration: :class:`compas_fab.robots.Configuration`
            The robot's full configuration to display.
        show_visual: bool
           Whether or not to show the robot's visual meshes.
        show_collision: bool
           Whether or not to show the robot's collision meshes.
        show_frames: bool
           Whether or not to show the robot's joint frames.
        show_base_frame: bool
           Whether or not to show the robot's base frame.
        show_end_effector_frame: bool
            Whether or not to show the robot's end-effector frame.
    Output:
        visual: The robot's visual meshes.
        collision: The robot's collision meshes.
        frames: The robot's joint frames.
        base_frame: The robot's base frame.
        ee_frame: The robot's end-effector frame.
"""
from __future__ import print_function

if robot and configuration:
    #group = robot.main_group_name
    group="manipulator"
    print(group)

    robot.update(configuration, group, visual=show_visual, collision=show_collision)

    if show_visual:
        visual = robot.artist.draw_visual()

    if show_collision:
        collision = robot.artist.draw_collision()

    if show_frames:
        axes = robot.transformed_axes(configuration, group)
        frames = robot.transformed_frames(configuration, group)

    if show_base_frame:
        base_frame = robot.transformed_frames(configuration, group)[0]

    if show_end_effector_frame:
        ee_frame = robot.forward_kinematics(configuration, group)
        print("End-effector", ee_frame)
# ---------- end visualize ----------
draw = GhPythonScript(frames=[visualize.frames, visualize.ee_frame, visualize.base_frame], scale=Slider(0.1, range=0..1))  # -> P, V, C, W; inputs frames: list
# ---------- draw: Python ----------
from System.Drawing import Color
from compas_ghpython.utilities import draw_frame

red = Color.FromArgb(255, 0, 0)
green = Color.FromArgb(0, 255, 0)
blue = Color.FromArgb(0, 0, 255)

P = []
V = []
C = []

scale = float(scale)

for frame in frames:
    if not frame:
        continue
    plane = draw_frame(frame)
    P += [plane.Origin] * 3
    V.append(plane.XAxis * scale)
    V.append(plane.YAxis * scale)
    V.append(plane.ZAxis * scale)
    C += [red, green, blue]

W = 3
# ---------- end draw ----------
geo = Geometry(visualize.collision)
geo_2 = Geometry(visualize.visual)
vdisex = VectorDisplayEx(Point=draw.P, Vector=draw.V, Colour=draw.C, Width=draw.W)
